# Grasshopper definition 2D-3D_exo.gh (Grasshopper 0.9.76)

path = FilePath("C:\Users\doorn\OneDrive\Docs\Soft-Robotics\NUS SR\Models\2D-3D_EXO\Test Images\output.csv")
file = ReadFile(F=path, PerLineParse=True)  # -> C
#   port F: Uri of file to read
# ---------- file: VB line parser ----------
    action = GH_LineParserAction.Include
    Return line

    'Parse the line and return some data that represents the line.
    'If the line cannot be parsed, you can return Nothing and
    'assign a different action.
    'The default implementation is to just return the line itself.
    'If you return types that implement IGH_Goo, this component
    'will work substantially faster.
# ---------- end file ----------
panel = Panel(file)
number_slider = Slider(3, range=0..13)
range = Range(Domain=number_slider, Steps=number_slider)
item = ListItem(List=panel, Index=range, Wrap=True)
subset = SubList(List=panel, Domain=range, Wrap=True)  # -> List, Index
partition = PartitionList(List=panel, Size=Slider(4, range=0..13))
panel_2 = Panel(partition)
item_2 = ListItem(List=panel_2, Index=Slider(0, range=0..13), Wrap=True)
item_3 = ListItem(List=panel_2, Index=Slider(1, range=0..13), Wrap=True)
item_4 = ListItem(List=panel_2, Index=Slider(2, range=0..13), Wrap=True)
item_5 = ListItem(List=panel_2, Index=number_slider, Wrap=True)
pt = ConstructPoint(XCoordinate=item_2, YCoordinate=item_3, ZCoordinate=0)
pt_2 = ConstructPoint(XCoordinate=item_4, YCoordinate=item_5, ZCoordinate=0)
ln = Line(StartPoint=pt, EndPoint=pt_2)
pln = Plane(ln)
deplane = DeconstructPlane(Plane=pln)  # -> Origin, XAxis, YAxis, ZAxis
pl = PlaneNormal(Origin=deplane.Origin, ZAxis=deplane.XAxis)

sdiff = SolidDifference()
sunion = SolidUnion()

preview = CustomPreview(Geometry=sdiff, Shader=ColourSwatch(SwatchColor=RGB(255, 0, 0)))
preview_2 = CustomPreview(Geometry=sunion, Shader=ColourSwatch(SwatchColor=RGB(255, 255, 255)))
